# Grasshopper definition platonic_solids.gh (Grasshopper 0.9.80)
# plug-ins: Python Interpreter, LunchBox

eigenvector = Slider(35, range=0..40)
phi = Slider(0, range=0..360)
number_of_solids = Slider(2, range=0..10)
attachpointindex = Slider(3, range=0..19)
theta2 = Slider(44.82, range=0..360)
theta1 = Slider(46.544, range=0..360)
phi_2 = Slider(200, range=0..360)
attachmode = ValueList({"Vertex": 1, "Edge": 2, "Face": 3}, selected="Edge")
platoicosa = PlatonicIcosahedron(Plane=PlaneXY(0, 0, 0), Radius=10, Truncation=0.38198)
platododec = PlatonicDodecahedron(Plane=PlaneXY(0, 0, 0), Radius=10)
platoocta = PlatonicOctahedron(Plane=PlaneXY(0, 0, 0), Radius=10, Truncation=0)
platocube = PlatonicCube(Plane=PlaneXY(0, 0, 0), Radius=10, Truncation=0)
platotetra = PlatonicTetrahedron(Plane=PlaneXY(0, 0, 0), Radius=10, Truncation=0)
python = PythonScript(Eigenvector=eigenvector, scalingFactor=phi)  # -> out, distortions
# ---------- python: Python ----------
__author__ = "elliottperryman"
# imports
import rhinoscriptsyntax as rs
from Rhino.Geometry import Point3d, Plane, Vector3d
Eigenvector = int(Eigenvector)

filePath = 'Users/elliottperryman/Documents/Dropbox Files/'

# read in vertices
with open(filePath+'vertices.csv', 'r') as file:
	data = file.read().split('\n')[:-1]
data = [x.split(',') for x in data]
data = [[float(y) for y in x] for x in data]
vertices = [Point3d(*data[i]) for i in range(len(data))]

# read in eigenvalues
with open(filePath+'eigenvalues.csv', 'r') as file:
	data = file.read().split('\n')[:-1]
data = [x.split(',') for x in data]
eigenvalues = [[float(y) for y in x][0] for x in data]

# read in eigenvectors
with open(filePath+'eigenvectors.csv', 'r') as file:
	data = file.read().split('\n')[:-1]
data = [x.split(',') for x in data]
eigenvectors = [[float(y)*scalingFactor for y in x] for x in data]
N = int(len(eigenvectors)/3)
print(N)


distortions = []
for i in range(len(vertices)):
	start = vertices[i]
	end = vertices[i] + Point3d(*eigenvectors[Eigenvector][i*3:i*3+3])
	print(start, end)
	newLine = rs.AddLine(start, end)
	distortions.append(newLine)
# ---------- end python ----------
platonicsolidtype = ValueList({"Tetrahedron": 0, "Cube": 1, "Octahedron": 2, "Dodecahedron": 3, "Icosahedron": 4}, selected="Tetrahedron")
create_plato_chain = PythonScript(
    platonicSolidType=platonicsolidtype,
    platonicSolid=platotetra,
    attachMode=attachmode,
    attachPointIndex=attachpointindex,
    phi=phi_2,
    numShapes=number_of_solids,
    theta1=theta1,
    theta2=theta2)  # -> out, chainedSolids
# ---------- create_plato_chain: Python ----------
__author__ = "elliottperryman"

##############
## To do:
##  * change variable names to be more useful and accurate
##############

# imports
import rhinoscriptsyntax as rs
from Rhino.Geometry import Point3d, Plane, Vector3d
import os

# setting up basics
attachPointIndex = int(attachPointIndex)
numShapes = int(numShapes)
chainedSolids = [platonicSolid]
origin = Point3d(0,0,0)
objectInfo = {0:(3,3,4), 1:(4,3,6), 2:(3,4,6), 3:(5,3,10), 4:(3,5,10)}
p, q, h = objectInfo[platonicSolidType]
numVertices = 4*p//(4-(p-2)*(q-2))
numEdges = 2*p*q//(4-(p-2)*(q-2))
numFaces = 2 - numVertices + numEdges


for i in range(numShapes-1):

	# if attaching on a vertex
	if attachMode == 1:

		pointCenter = rs.SurfaceVolumeCentroid(chainedSolids[-1])[0]	
		# select the point
		edges = rs.DuplicateEdgeCurves(chainedSolids[-1])
		points = []
		for j in range(len(edges)):
			for pt in [rs.CurveStartPoint(edges[j]), rs.CurveEndPoint(edges[j])]:
				if sum([pt==x for x in points])==0:
					points.append(pt)

		if platonicSolidType==0:
			slidingEdge = edges[attachPointIndex//2]
			translation = rs.CurveEndPoint(slidingEdge) - rs.CurveStartPoint(slidingEdge)
			if attachPointIndex%2: translation *= -1
			newSolid = rs.CopyObject(chainedSolids[-1], translation)
			chainedSolids.append(newSolid)
			# rotate based on the point that it is connected to
			newSolid = rs.RotateObject(newSolid, rs.CurveEndPoint(slidingEdge), phi, axis=[0,0,1], copy=False)
			newSolid = rs.RotateObject(newSolid, rs.CurveEndPoint(slidingEdge), theta1, axis=[1,0,0], copy=False)
			newSolid = rs.RotateObject(newSolid, rs.CurveEndPoint(slidingEdge), theta2, axis=[0,1,0], copy=False)

			continue

		attachPoint = points[attachPointIndex]	
		# calculate the translation of the new object
		translation = (attachPoint - pointCenter)*2

		# make the new object with the translation
		newSolid = rs.CopyObject(chainedSolids[-1], translation)


		# rotate based on the point that it is connected to
		newSolid = rs.RotateObject(newSolid, attachPoint, phi, axis=[0,0,1], copy=False)
		newSolid = rs.RotateObject(newSolid, attachPoint, theta1, axis=[1,0,0], copy=False)
		newSolid = rs.RotateObject(newSolid, attachPoint, theta2, axis=[0,1,0], copy=False)

		# update the list of solids
		chainedSolids.append(newSolid)


	# if attaching on an edge
	elif attachMode == 2:
	
		pointCenter = rs.SurfaceVolumeCentroid(chainedSolids[-1])[0]	
		# select the edge
		edges = rs.DuplicateEdgeCurves(chainedSolids[-1])
		attachEdge = edges[attachPointIndex]
		#print(attachEdge, len(edges))
		
		# calculate the translation of the new object
		endMidPoint = rs.CurveMidPoint(attachEdge)
		startPoint = pointCenter
		translation = (endMidPoint - startPoint)*2
		#print(endMidPoint, startPoint, translation)	

		# make the new object with the translation
		newSolid = rs.CopyObject(chainedSolids[-1])
		newSolid = rs.MoveObject(newSolid, translation)


		# rotate based on the edge that it is connected to
		rotateAxis = Vector3d(rs.CurveEndPoint(attachEdge) - rs.CurveStartPoint(attachEdge))
		newSolid = rs.RotateObject(newSolid, endMidPoint, phi+90, axis=rotateAxis, copy=False)

		if platonicSolidType==0:
			edges = rs.DuplicateEdgeCurves(newSolid)
			attachEdge = edges[(attachPointIndex-2)%4]
			print(attachEdge)
			rotateAxis = Vector3d(rs.CurveEndPoint(attachEdge) - rs.CurveStartPoint(attachEdge))
			if attachPointIndex>2:
				rotateAngle = 109.47122063449069
			else:
				rotateAngle = 250
			newSolid = rs.RotateObject(newSolid, endMidPoint, rotateAngle, axis=rotateAxis, copy=False)

		# update the list of solids
		chainedSolids.append(newSolid)

	# if attaching on a face
	elif attachMode == 3:
	
		pointCenter = rs.SurfaceVolumeCentroid(chainedSolids[-1])[0]	
		# select the face
		surfs = rs.ExplodePolysurfaces(chainedSolids[-1])
		attachPoint = rs.SurfaceAreaCentroid(surfs[attachPointIndex])[0]

		# calculate the translation of the new object
		translation = (attachPoint - pointCenter)*2

		# make the new object with the translation
		newSolid = rs.CopyObject(chainedSolids[-1], translation)

		if platonicSolidType==0:
			pass
		
		# this is needed to rotate the objects so that the corners line up
		newSolid = rs.RotateObject(newSolid, attachPoint, [0,0,180,108,60][platonicSolidType], axis=attachPoint-pointCenter, copy=False)	
		# rotate based on the point that it is connected to
		newSolid = rs.RotateObject(newSolid, attachPoint, phi, axis=[0,0,1], copy=False)
		newSolid = rs.RotateObject(newSolid, attachPoint, theta1, axis=[1,0,0], copy=False)
		newSolid = rs.RotateObject(newSolid, attachPoint, theta2, axis=[0,1,0], copy=False)
		
		# update the list of solids
		chainedSolids.append(newSolid)

	else:
		print('the inputs have changed!! go back and figure it out, ya goober')


# write the edge data to a file
# don't worry about being unique, I can handle that
fileName = 'Users/elliottperryman/Documents/platonicSolidsOutput.csv'
os.system('rm '+fileName)
with open(fileName,'w') as file:
	for i in range(len(chainedSolids)):
		e = rs.DuplicateEdgeCurves(chainedSolids[i])
		for j in range(len(e)):
			file.write(str(rs.CurveStartPoint(e[j]))+','+str(rs.CurveEndPoint(e[j]))+'\n')
# ---------- end create_plato_chain ----------
panel = Panel(python.out)
panel_2 = Panel(python.distortions)
panel_3 = Panel(create_plato_chain.out)
panel_4 = Panel(create_plato_chain.chainedSolids)
